# Grasshopper definition COS200 Final.gh (Grasshopper 1.0.7)

max_height = Slider(10, range=2..50)
max_height_2 = Slider(10, range=2..50)
curve = Curve(<curve referenced from the Rhino model>)
surface_from_points = SurfaceFromPoints(Interpolate=False)
ghpython_script = GhPythonScript(Area=curve, Detail=max_height_2, Max_Height=max_height)  # -> out, a; inputs Area: Curve, Max_Height: Int32
# ---------- ghpython_script: Python ----------
__author__ = "Colby W"

import rhinoscriptsyntax as rs
import ghpythonlib.components as ghp

points = ghp.Populate2D(Area, Detail, 1)

ghp.SurfaceFromPoints(points
# ---------- end ghpython_script ----------
